# Dynamo graph Dynamo_Materiais_Excel.dyn "Exportar_Materiais_Excel" (Dynamo 2.5.0.7460)

file_path = Filename(".\Materiais Revit.xlsx")
code_block = CodeBlock { "Materiais"; }
code_block_2 = CodeBlock { 1; }
code_block_3 = CodeBlock { 0; }
categories = Categories("OST_Materials")
all_elements_of_category = ElementsOfCategory(Category=categories)
name = Element.Name(element=all_elements_of_category)
code_block_4 = CodeBlock { "Base"; }
getParameterValueByName = Element.GetParameterValueByName(element=all_elements_of_category, parameterName=code_block_4)
code_block_5 = CodeBlock { "Codigo"; }
getParameterValueByName_2 = Element.GetParameterValueByName(element=all_elements_of_category, parameterName=code_block_5)
code_block_6 = CodeBlock { "Descrição"; }
getParameterValueByName_3 = Element.GetParameterValueByName(element=all_elements_of_category, parameterName=code_block_6)
code_block_7 = CodeBlock { "Unidade"; }
getParameterValueByName_4 = Element.GetParameterValueByName(element=all_elements_of_category, parameterName=code_block_7)
code_block_8 = CodeBlock { "Custo"; }
getParameterValueByName_5 = Element.GetParameterValueByName(element=all_elements_of_category, parameterName=code_block_8)
code_block_9 = CodeBlock { "Etapa"; }
getParameterValueByName_6 = Element.GetParameterValueByName(element=all_elements_of_category, parameterName=code_block_9)
list_create = List.Create(item0=name, item1=getParameterValueByName, item2=getParameterValueByName_2, item3=getParameterValueByName_3, item4=getParameterValueByName_4, item5=getParameterValueByName_5, item6=getParameterValueByName_6)
transpose = List.Transpose(lists=list_create@L3)
boolean = BoolSelector(true)
exportExcel = Data.ExportExcel(filePath=file_path, sheetName=code_block, startRow=code_block_2, startCol=code_block_3, data=transpose, overWrite=boolean)  # graph output
