# Dynamo graph Excel_Materiais_Dynamo.dyn "Importar_Materiais_Excel" (Dynamo 2.5.0.7460)
# packages: spring nodes 204.1.0, Clockwork for Dynamo 2.x 2.3.0

categories = Categories("OST_Materials")
all_elements_of_category = ElementsOfCategory(Category=categories)
code_block = CodeBlock { "Codigo"; }
file_path = Filename("E:\Área de Trabalho\WILLIAM\REVIT\08.Materiais\Materiais Revit.xlsx")
file_from_path = FileObject(path=file_path)
code_block_2 = CodeBlock { "Materiais"; }
boolean = BoolSelector(false)
importExcel = Data.ImportExcel(file=file_from_path, sheetName=code_block_2, showExcel=boolean)
transpose = List.Transpose(lists=importExcel)
code_block_3 = CodeBlock(Nome=transpose) { Nome[0]; }
code_block_4 = CodeBlock(Codigo=transpose) { Codigo[2]; }
name = Element.Name(element=all_elements_of_category)
ꟿ_dictionary_bykeysvalues = Custom[ꟿ Dictionary.ByKeysValues](keys=code_block_3, values=code_block_4, searchKeys=name)  # package spring nodes; Dictionaries are an incredibly powerful tool for making associative sets between two equal length lists. The first list must be of unique strings (or numbers) and will be the key and the second list will be the matching values (it can be made up of geometry, elements, even other lists) The search keys list will provide the corresponding value to the input key.
code_block_5 = CodeBlock { ""; }
replaceNull = Custom[List.ReplaceNull](seq=ꟿ_dictionary_bykeysvalues, replacement=code_block_5)  # package Clockwork for Dynamo 2.x; Replaces all null values within a given list with a substitute
setParameterByName = Element.SetParameterByName(element=all_elements_of_category, parameterName=code_block, value=replaceNull)
code_block_6 = CodeBlock { "Descrição"; }
code_block_7 = CodeBlock(Descrição=transpose) { Descrição[3]; }
ꟿ_dictionary_bykeysvalues_2 = Custom[ꟿ Dictionary.ByKeysValues](keys=code_block_3, values=code_block_7, searchKeys=name)
code_block_8 = CodeBlock { ""; }
replaceNull_2 = Custom[List.ReplaceNull](seq=ꟿ_dictionary_bykeysvalues_2, replacement=code_block_8)
setParameterByName_2 = Element.SetParameterByName(element=all_elements_of_category, parameterName=code_block_6, value=replaceNull_2)
code_block_9 = CodeBlock { "Unidade"; }
code_block_10 = CodeBlock(Unidade=transpose) { Unidade[4]; }
ꟿ_dictionary_bykeysvalues_3 = Custom[ꟿ Dictionary.ByKeysValues](keys=code_block_3, values=code_block_10, searchKeys=name)
code_block_11 = CodeBlock { ""; }
replaceNull_3 = Custom[List.ReplaceNull](seq=ꟿ_dictionary_bykeysvalues_3, replacement=code_block_11)
setParameterByName_3 = Element.SetParameterByName(element=all_elements_of_category, parameterName=code_block_9, value=replaceNull_3)
code_block_12 = CodeBlock { "Custo"; }
code_block_13 = CodeBlock(Custo=transpose) { Custo[5]; }
ꟿ_dictionary_bykeysvalues_4 = Custom[ꟿ Dictionary.ByKeysValues](keys=code_block_3, values=code_block_13, searchKeys=name)
code_block_14 = CodeBlock { ""; }
replaceNull_4 = Custom[List.ReplaceNull](seq=ꟿ_dictionary_bykeysvalues_4, replacement=code_block_14)
setParameterByName_4 = Element.SetParameterByName(element=all_elements_of_category, parameterName=code_block_12, value=replaceNull_4)
code_block_15 = CodeBlock { "Etapa"; }
code_block_16 = CodeBlock(Etapa=transpose) { Etapa[6]; }
ꟿ_dictionary_bykeysvalues_5 = Custom[ꟿ Dictionary.ByKeysValues](keys=code_block_3, values=code_block_16, searchKeys=name)
code_block_17 = CodeBlock { ""; }
replaceNull_5 = Custom[List.ReplaceNull](seq=ꟿ_dictionary_bykeysvalues_5, replacement=code_block_17)
setParameterByName_5 = Element.SetParameterByName(element=all_elements_of_category, parameterName=code_block_15, value=replaceNull_5)
code_block_18 = CodeBlock { "Base"; }
code_block_19 = CodeBlock(Base=transpose) { Base[1]; }
ꟿ_dictionary_bykeysvalues_6 = Custom[ꟿ Dictionary.ByKeysValues](keys=code_block_3, values=code_block_19, searchKeys=name)
code_block_20 = CodeBlock { ""; }
replaceNull_6 = Custom[List.ReplaceNull](seq=ꟿ_dictionary_bykeysvalues_6, replacement=code_block_20)
setParameterByName_6 = Element.SetParameterByName(element=all_elements_of_category, parameterName=code_block_18, value=replaceNull_6)
code_block_21 = CodeBlock { ""; }
removeItemAtIndex = List.RemoveItemAtIndex(list=transpose, indices=code_block_21, lacing=Longest)  # frozen
