# Dynamo graph Exportar_Tabelas_Excel.dyn (Dynamo 2.5.0.7460)
# packages: bimorphNodes 3.0.3

file_path = Filename(".\Tabela.xlsx")
code_block = CodeBlock { "Quant.Tijolos"; }
code_block_2 = CodeBlock { 1; }
code_block_3 = CodeBlock { 0; }
element_types = ElementTypes("ViewSchedule")
all_elements_of_type = ElementsOfType(element_type=element_types)
getData = Revit.Schedule.GetData(scheduleView=all_elements_of_type)
transpose = List.Transpose(lists=getData)
boolean = BoolSelector(true)
exportExcel = Data.ExportExcel(filePath=file_path, sheetName=code_block, startRow=code_block_2, startCol=code_block_3, data=transpose, overWrite=boolean)  # graph output
name = Element.Name(element=all_elements_of_type)
